# Grasshopper definition button_push.gh (Grasshopper 1.0.7)

button_thickness = Vector(Vector(0, 1, 0))
button_radius = Number(5)
pln = Plane(PlaneXZ(0, 0, 0))
cir = Circle(Plane=pln, Radius=button_radius)
srf = Surface(cir)
extr = Extrude(Base=srf, Direction=button_thickness)
