# Grasshopper definition button_support.gh (Grasshopper 1.0.7)

pln = Plane(PlaneXZ(0, 0, 0))
support_length = Vector(Vector(0, -2, 0))
r_e_support = Number(2.3)
r_i_support = Number(1.05)
r_i_clip = Number(1.4)
r_e_clip = Number(1.8)
cir = Circle(Plane=pln, Radius=r_e_support)
cir_2 = Circle(Plane=pln, Radius=r_i_support)
cir_3 = Circle(Plane=pln, Radius=r_e_clip)
cir_4 = Circle(Plane=pln, Radius=r_i_clip)
clip_depth = Vector(Vector(0, -0.5, 0))
srf = Surface(cir)
srf_2 = Surface(cir_2)
srf_3 = Surface(cir_4)
srf_4 = Surface(cir_3)
extr = Extrude(Base=srf, Direction=support_length)
extr_2 = Extrude(Base=srf_2, Direction=support_length)
extr_3 = Extrude(Base=srf_4, Direction=clip_depth)
extr_4 = Extrude(Base=srf_3, Direction=clip_depth)
sdiff = SolidDifference(BrepsA=extr, BrepsB=extr_2)
sdiff_2 = SolidDifference(BrepsA=extr_3, BrepsB=extr_4)
sdiff_3 = SolidDifference(BrepsA=sdiff, BrepsB=sdiff_2)

button_thickness = Vector(Vector(0, 1, 0))
button_thickness_2 = Vector(Vector(0, -0.7, 0))
button_radius = Number(5)
number = Number(0.7853981634)
number_2 = Number(0.7853981634)
number_3 = Number(0.7853981634)
number_4 = Number(0.7853981634)
central_shaft_length = Vector(Vector(0, 2, 0))

vec = Vector(Vector(0, -2, 0))
pl_offset = PlaneOffset(BasePlane=pln, Offset=vec)
dent_depth = Vector(Vector(0, 0.2, 0))
dent_radius = Number(0.85)
cir_5 = Circle(Plane=pl_offset, Radius=r_i_support)
cir_6 = Circle(Plane=pl_offset, Radius=dent_radius)
srf_5 = Surface(cir_6)
srf_6 = Surface(cir_5)
extr_5 = Extrude(Base=srf_6, Direction=dent_depth)
extr_6 = Extrude(Base=srf_5, Direction=dent_depth)
sdiff_4 = SolidDifference(BrepsA=extr_5, BrepsB=extr_6)

angular_section = Number(0.3)
num = Number(2)
num_2 = Number(0)
number_5 = Number(1.570796327)
pt = PointCylindrical(BasePlane=pl_offset, Angle=angular_section, Radius=num, Elevation=0)
pt_2 = PointCylindrical(BasePlane=pl_offset, Angle=0, Radius=num_2, Elevation=0)
pt_3 = PointCylindrical(BasePlane=pl_offset, Angle=number_5, Radius=num, Elevation=0)
bool = Boolean(True)
pline = PolyLine(Vertices=[pt_2, pt, pt_3], Closed=bool)
vec_2 = Vector(Vector(0, 1, 0))
boundary = BoundarySurfaces(Edges=pline)
extr_7 = Extrude(Base=boundary, Direction=vec_2)

angular_section_2 = Number(0.32)
num_3 = Number(2)
num_4 = Number(0)
number_6 = Number(1.570796327)
pt_4 = PointCylindrical(BasePlane=pl_offset, Angle=angular_section_2, Radius=num_3, Elevation=0)
pt_5 = PointCylindrical(BasePlane=pl_offset, Angle=0, Radius=num_4, Elevation=0)
pt_6 = PointCylindrical(BasePlane=pl_offset, Angle=number_6, Radius=num_3, Elevation=0)
bool_2 = Boolean(True)
pline_2 = PolyLine(Vertices=[pt_5, pt_4, pt_6], Closed=bool_2)
vec_3 = Vector(Vector(0, 2, 0))
boundary_2 = BoundarySurfaces(Edges=pline_2)
extr_8 = Extrude(Base=boundary_2, Direction=vec_3)

dent_depth_2 = Vector(Vector(0, 2, 0))
dent_radius_2 = Number(0.83)
cir_7 = Circle(Plane=pl_offset, Radius=r_i_support)
cir_8 = Circle(Plane=pl_offset, Radius=dent_radius_2)
srf_7 = Surface(cir_8)
srf_8 = Surface(cir_7)
extr_9 = Extrude(Base=srf_8, Direction=dent_depth_2)
extr_10 = Extrude(Base=srf_7, Direction=dent_depth_2)
sdiff_5 = SolidDifference(BrepsA=extr_9, BrepsB=extr_10)
rotate = Rotate(Geometry=extr_8, Angle=1.570796327, Plane=pl_offset)  # -> Geometry, Transform
sdiff_6 = SolidDifference(BrepsA=sdiff_5, BrepsB=extr_8)
rotate_2 = Rotate(Geometry=rotate.Geometry, Angle=1.570796327, Plane=pl_offset)  # -> Geometry, Transform
sdiff_7 = SolidDifference(BrepsA=sdiff_6, BrepsB=rotate.Geometry)
rotate_3 = Rotate(Geometry=rotate_2.Geometry, Angle=1.570796327, Plane=pl_offset)  # -> Geometry, Transform
sdiff_8 = SolidDifference(BrepsA=sdiff_7, BrepsB=rotate_2.Geometry)
sdiff_9 = SolidDifference(BrepsA=sdiff_8, BrepsB=rotate_3.Geometry)

cir_9 = Circle(Plane=pl_offset, Radius=button_radius)
srf_9 = Surface(cir_9)
extr_11 = Extrude(Base=srf_9, Direction=button_thickness_2)

rotate_4 = Rotate(Geometry=extr_7, Angle=1.570796327, Plane=pl_offset)  # -> Geometry, Transform
sdiff_10 = SolidDifference(BrepsA=sdiff_4, BrepsB=extr_7)
rotate_5 = Rotate(Geometry=rotate_4.Geometry, Angle=1.570796327, Plane=pl_offset)  # -> Geometry, Transform
sdiff_11 = SolidDifference(BrepsA=sdiff_10, BrepsB=rotate_4.Geometry)
rotate_6 = Rotate(Geometry=rotate_5.Geometry, Angle=1.570796327, Plane=pl_offset)  # -> Geometry, Transform
sdiff_12 = SolidDifference(BrepsA=sdiff_11, BrepsB=rotate_5.Geometry)
sdiff_13 = SolidDifference(BrepsA=sdiff_12, BrepsB=rotate_6.Geometry)

cir_10 = Circle(Plane=pl_offset, Radius=r_i_support)
srf_10 = Surface(cir_10)
extr_12 = Extrude(Base=srf_10, Direction=central_shaft_length)
sdiff_14 = SolidDifference(BrepsA=extr_12, BrepsB=sdiff_9)

dent_radius_3 = Number(0.83)
dent_depth_3 = Vector(Vector(0, 0.22, 0))
cir_11 = Circle(Plane=pl_offset, Radius=r_i_support)
cir_12 = Circle(Plane=pl_offset, Radius=dent_radius_3)
srf_11 = Surface(cir_12)
srf_12 = Surface(cir_11)
extr_13 = Extrude(Base=srf_12, Direction=dent_depth_3)
extr_14 = Extrude(Base=srf_11, Direction=dent_depth_3)
sdiff_15 = SolidDifference(BrepsA=extr_13, BrepsB=extr_14)

angular_section_3 = Number(0.8)
number_7 = Number(1.570796327)
num_5 = Number(2)
num_6 = Number(0)
pt_7 = PointCylindrical(BasePlane=pl_offset, Angle=0, Radius=num_6, Elevation=0)
bool_3 = Boolean(True)
vec_4 = Vector(Vector(0, 2, 0))

addition = Addition(A=number, B=number_7)
addition_2 = Addition(A=angular_section_3, B=number_3)

pt_8 = PointCylindrical(BasePlane=pl_offset, Angle=addition_2, Radius=num_5, Elevation=0)
pt_9 = PointCylindrical(BasePlane=pl_offset, Angle=addition, Radius=num_5, Elevation=0)
pline_3 = PolyLine(Vertices=[pt_7, pt_8, pt_9], Closed=bool_3)
boundary_3 = BoundarySurfaces(Edges=pline_3)
extr_15 = Extrude(Base=boundary_3, Direction=vec_4)

rotate_7 = Rotate(Geometry=extr_15, Angle=1.570796327, Plane=pl_offset)  # -> Geometry, Transform
sdiff_16 = SolidDifference(BrepsA=sdiff_15, BrepsB=extr_15)
rotate_8 = Rotate(Geometry=rotate_7.Geometry, Angle=1.570796327, Plane=pl_offset)  # -> Geometry, Transform
sdiff_17 = SolidDifference(BrepsA=sdiff_16, BrepsB=rotate_7.Geometry)
rotate_9 = Rotate(Geometry=rotate_8.Geometry, Angle=1.570796327, Plane=pl_offset)  # -> Geometry, Transform
sdiff_18 = SolidDifference(BrepsA=sdiff_17, BrepsB=rotate_8.Geometry)
sdiff_19 = SolidDifference(BrepsA=sdiff_18, BrepsB=rotate_9.Geometry)

dent_depth_4 = Vector(Vector(0, 1.5, 0))
dent_radius_4 = Number(0.83)
cir_13 = Circle(Plane=pl_offset, Radius=r_i_support)
cir_14 = Circle(Plane=pl_offset, Radius=dent_radius_4)
srf_13 = Surface(cir_14)
srf_14 = Surface(cir_13)
extr_16 = Extrude(Base=srf_14, Direction=dent_depth_4)
extr_17 = Extrude(Base=srf_13, Direction=dent_depth_4)
sdiff_20 = SolidDifference(BrepsA=extr_16, BrepsB=extr_17)

angular_section_4 = Number(0.32)
number_8 = Number(1.570796327)
num_7 = Number(2)
num_8 = Number(0)
pt_10 = PointCylindrical(BasePlane=pl_offset, Angle=0, Radius=num_8, Elevation=0)
bool_4 = Boolean(True)
vec_5 = Vector(Vector(0, 2, 0))

addition_3 = Addition(A=number_2, B=number_8)
addition_4 = Addition(A=angular_section_4, B=number_4)

pt_11 = PointCylindrical(BasePlane=pl_offset, Angle=addition_4, Radius=num_7, Elevation=0)
pt_12 = PointCylindrical(BasePlane=pl_offset, Angle=addition_3, Radius=num_7, Elevation=0)
pline_4 = PolyLine(Vertices=[pt_10, pt_11, pt_12], Closed=bool_4)
boundary_4 = BoundarySurfaces(Edges=pline_4)
extr_18 = Extrude(Base=boundary_4, Direction=vec_5)

rotate_10 = Rotate(Geometry=extr_18, Angle=1.570796327, Plane=pl_offset)  # -> Geometry, Transform
sdiff_21 = SolidDifference(BrepsA=sdiff_20, BrepsB=extr_18)
rotate_11 = Rotate(Geometry=rotate_10.Geometry, Angle=1.570796327, Plane=pl_offset)  # -> Geometry, Transform
sdiff_22 = SolidDifference(BrepsA=sdiff_21, BrepsB=rotate_10.Geometry)
rotate_12 = Rotate(Geometry=rotate_11.Geometry, Angle=1.570796327, Plane=pl_offset)  # -> Geometry, Transform
sdiff_23 = SolidDifference(BrepsA=sdiff_22, BrepsB=rotate_11.Geometry)
sdiff_24 = SolidDifference(BrepsA=sdiff_23, BrepsB=rotate_12.Geometry)

sdiff_25 = SolidDifference(BrepsA=sdiff_14, BrepsB=sdiff_24)
sdiff_26 = SolidDifference(BrepsA=sdiff_25, BrepsB=sdiff_19)
