# Grasshopper definition crosswalk.gh (Grasshopper 1.0.7)

r3 = Number(1.8)
r2 = Number(1.4)
r1 = Number(1)
pln = Plane(PlaneXZ(0, 0, 0))
_11 = Number(11)
_40 = Number(40)
number = Number(-11)
number_2 = Number(0.5)
number_3 = Number(-5)
number_4 = Number(0.5)
_35 = Number(35)
_5 = Number(5)
number_5 = Number(7.5)
number_6 = Number(0.5)
_7_5 = Number(-7.5)
number_7 = Number(0.5)
num = Number(1.5)
num_2 = Number(0.5)
pt = ConstructPoint(XCoordinate=number, YCoordinate=number_2, ZCoordinate=number_3)
pt_2 = ConstructPoint(XCoordinate=_11, YCoordinate=number_4, ZCoordinate=_40)
pt_3 = ConstructPoint(XCoordinate=_7_5, YCoordinate=number_7, ZCoordinate=_5)
pt_4 = ConstructPoint(XCoordinate=number_5, YCoordinate=number_6, ZCoordinate=_35)
pln_2 = Plane(PlaneXZ(0, 0, 0))
pln_3 = Plane(PlaneXZ(0, 0, 0))
cir = Circle(Plane=pln, Radius=r1)
cir_2 = Circle(Plane=pln, Radius=r3)
cir_3 = Circle(Plane=pln, Radius=r2)
rec_2pt = Rectangle2Pt(Plane=pln_2, PointA=pt, PointB=pt_2, Radius=num)  # -> Rectangle, Length
rec_2pt_2 = Rectangle2Pt(Plane=pln_3, PointA=pt_3, PointB=pt_4, Radius=num_2)  # -> Rectangle, Length
srf = Surface(cir_3)
srf_2 = Surface(cir)
vec = Vector(Vector(0, -0.5, 0))
vec_2 = Vector(Vector(0, -0.5, 0))
srf_3 = Surface(cir_2)
vec_3 = Vector(Vector(0, -0.5, 0))
vec_4 = Vector(Vector(0, 10, 0))
srf_4 = Surface(rec_2pt_2.Rectangle)
srf_5 = Surface(rec_2pt.Rectangle)
vec_5 = Vector(Vector(0, 0.5, 0))
extr = Extrude(Base=srf, Direction=vec)
extr_2 = Extrude(Base=srf_2, Direction=vec_2)
extr_3 = Extrude(Base=srf_3, Direction=vec_3)
extr_4 = Extrude(Base=srf_5, Direction=vec_4)
extr_5 = Extrude(Base=srf_4, Direction=vec_5)
sdiff = SolidDifference(BrepsA=extr_3, BrepsB=extr)
sdiff_2 = SolidDifference(BrepsA=extr_4, BrepsB=extr_5)
