# Grasshopper definition sheath complete file-2.gh (Grasshopper 1.0.7)

r2 = Number(1.4)
r1 = Number(1)
r3 = Number(1.8)
pln = Plane(PlaneXZ(0, 0, 0))
_40 = Number(40)
_11 = Number(11)
number = Number(0.5)
number_2 = Number(-11)
number_3 = Number(0.5)
number_4 = Number(-5)
number_5 = Number(7.5)
number_6 = Number(0.5)
_35 = Number(35)
_7_5 = Number(-7.5)
number_7 = Number(0.5)
_5 = Number(5)
num = Number(1.5)
num_2 = Number(0.5)

pln_2 = Plane(PlaneXZ(0, 0, 0))
support_length = Vector(Vector(0, -2, 0))
r_e_support = Number(2.3)
r_i_support = Number(1.05)
r_i_clip = Number(1.4)
r_e_clip = Number(1.8)
cir = Circle(Plane=pln_2, Radius=r_e_support)
cir_2 = Circle(Plane=pln_2, Radius=r_i_support)
cir_3 = Circle(Plane=pln_2, Radius=r_e_clip)
cir_4 = Circle(Plane=pln_2, Radius=r_i_clip)
clip_depth = Vector(Vector(0, -0.5, 0))
srf = Surface(cir)
srf_2 = Surface(cir_2)
srf_3 = Surface(cir_4)
srf_4 = Surface(cir_3)
extr = Extrude(Base=srf, Direction=support_length)
extr_2 = Extrude(Base=srf_2, Direction=support_length)
extr_3 = Extrude(Base=srf_4, Direction=clip_depth)
extr_4 = Extrude(Base=srf_3, Direction=clip_depth)
sdiff = SolidDifference(BrepsA=extr, BrepsB=extr_2)
sdiff_2 = SolidDifference(BrepsA=extr_3, BrepsB=extr_4)
sdiff_3 = SolidDifference(BrepsA=sdiff, BrepsB=sdiff_2)

pt = ConstructPoint(XCoordinate=number_2, YCoordinate=number_3, ZCoordinate=number_4)
pt_2 = ConstructPoint(XCoordinate=_11, YCoordinate=number, ZCoordinate=_40)
pt_3 = ConstructPoint(XCoordinate=_7_5, YCoordinate=number_7, ZCoordinate=_5)
pt_4 = ConstructPoint(XCoordinate=number_5, YCoordinate=number_6, ZCoordinate=_35)
pln_3 = Plane(PlaneXZ(0, 0, 0))
pln_4 = Plane(PlaneXZ(0, 0, 0))
cir_5 = Circle(Plane=pln, Radius=r1)
cir_6 = Circle(Plane=pln, Radius=r3)
cir_7 = Circle(Plane=pln, Radius=r2)
rec_2pt = Rectangle2Pt(Plane=pln_3, PointA=pt, PointB=pt_2, Radius=num)  # -> Rectangle, Length
rec_2pt_2 = Rectangle2Pt(Plane=pln_4, PointA=pt_3, PointB=pt_4, Radius=num_2)  # -> Rectangle, Length
srf_5 = Surface(cir_7)
srf_6 = Surface(cir_5)
vec = Vector(Vector(0, -0.5, 0))
vec_2 = Vector(Vector(0, -0.5, 0))
srf_7 = Surface(cir_6)
vec_3 = Vector(Vector(0, -0.5, 0))
vec_4 = Vector(Vector(0, 10, 0))
srf_8 = Surface(rec_2pt_2.Rectangle)
srf_9 = Surface(rec_2pt.Rectangle)
vec_5 = Vector(Vector(0, 0.5, 0))
extr_5 = Extrude(Base=srf_5, Direction=vec)
extr_6 = Extrude(Base=srf_6, Direction=vec_2)
extr_7 = Extrude(Base=srf_7, Direction=vec_3)
extr_8 = Extrude(Base=srf_9, Direction=vec_4)
extr_9 = Extrude(Base=srf_8, Direction=vec_5)
button_thickness = Vector(Vector(0, 1, 0))
button_thickness_2 = Vector(Vector(0, -0.7, 0))
button_radius = Number(5)
push_diameter_reduction = Number(0.15)
tolerance = Number(0.015)
sdiff_4 = SolidDifference(BrepsA=extr_7, BrepsB=extr_5)
push_depth = Vector(Vector(0, -0.5, 0))
sdiff_5 = SolidDifference(BrepsA=extr_8, BrepsB=extr_9)
number_8 = Number(0.7853981634)
number_9 = Number(0.7853981634)
number_10 = Number(0.7853981634)
number_11 = Number(0.7853981634)
X = UnitX(Factor=Slider(10, range=0..10))
subtraction = Subtraction(A=r_i_support, B=tolerance)
Y = UnitY(Factor=Slider(4, range=0..10))
subtraction_2 = Subtraction(A=r_i_support, B=push_diameter_reduction)
Y_2 = UnitY(Factor=expr("-x", Slider(10, range=0..10)))
cir_8 = Circle(Plane=pln_2, Radius=r_i_support)
cir_9 = Circle(Plane=pln_2, Radius=subtraction_2)
central_shaft_length = Vector(Vector(0, 2, 0))
srf_10 = Surface(cir_8)
srf_11 = Surface(cir_9)
extr_10 = Extrude(Base=srf_10, Direction=push_depth)
extr_11 = Extrude(Base=srf_11, Direction=push_depth)
sdiff_6 = SolidDifference(BrepsA=extr_10, BrepsB=extr_11)

vec_6 = Vector(Vector(0, -2, 0))
pl_offset = PlaneOffset(BasePlane=pln_2, Offset=vec_6)
dent_depth = Vector(Vector(0, 0.2, 0))
dent_radius = Number(0.85)
cir_10 = Circle(Plane=pl_offset, Radius=r_i_support)
cir_11 = Circle(Plane=pl_offset, Radius=dent_radius)
srf_12 = Surface(cir_11)
srf_13 = Surface(cir_10)
extr_12 = Extrude(Base=srf_13, Direction=dent_depth)
extr_13 = Extrude(Base=srf_12, Direction=dent_depth)
sdiff_7 = SolidDifference(BrepsA=extr_12, BrepsB=extr_13)

angular_section = Number(0.3)
num_3 = Number(2)
num_4 = Number(0)
number_12 = Number(1.570796327)
pt_5 = PointCylindrical(BasePlane=pl_offset, Angle=angular_section, Radius=num_3, Elevation=0)
pt_6 = PointCylindrical(BasePlane=pl_offset, Angle=0, Radius=num_4, Elevation=0)
pt_7 = PointCylindrical(BasePlane=pl_offset, Angle=number_12, Radius=num_3, Elevation=0)
bool = Boolean(True)
pline = PolyLine(Vertices=[pt_6, pt_5, pt_7], Closed=bool)
vec_7 = Vector(Vector(0, 1, 0))
boundary = BoundarySurfaces(Edges=pline)
extr_14 = Extrude(Base=boundary, Direction=vec_7)

angular_section_2 = Number(0.32)
num_5 = Number(2)
num_6 = Number(0)
number_13 = Number(1.570796327)
pt_8 = PointCylindrical(BasePlane=pl_offset, Angle=angular_section_2, Radius=num_5, Elevation=0)
pt_9 = PointCylindrical(BasePlane=pl_offset, Angle=0, Radius=num_6, Elevation=0)
pt_10 = PointCylindrical(BasePlane=pl_offset, Angle=number_13, Radius=num_5, Elevation=0)
bool_2 = Boolean(True)
pline_2 = PolyLine(Vertices=[pt_9, pt_8, pt_10], Closed=bool_2)
vec_8 = Vector(Vector(0, 2, 0))
boundary_2 = BoundarySurfaces(Edges=pline_2)
extr_15 = Extrude(Base=boundary_2, Direction=vec_8)

dent_radius_2 = Number(0.83)
dent_depth_2 = Vector(Vector(0, 2, 0))
cir_12 = Circle(Plane=pl_offset, Radius=r_i_support)
cir_13 = Circle(Plane=pl_offset, Radius=dent_radius_2)
srf_14 = Surface(cir_13)
srf_15 = Surface(cir_12)
extr_16 = Extrude(Base=srf_15, Direction=dent_depth_2)
extr_17 = Extrude(Base=srf_14, Direction=dent_depth_2)
sdiff_8 = SolidDifference(BrepsA=extr_16, BrepsB=extr_17)
rotate = Rotate(Geometry=extr_15, Angle=1.570796327, Plane=pl_offset)  # -> Geometry, Transform
sdiff_9 = SolidDifference(BrepsA=sdiff_8, BrepsB=extr_15)
rotate_2 = Rotate(Geometry=rotate.Geometry, Angle=1.570796327, Plane=pl_offset)  # -> Geometry, Transform
sdiff_10 = SolidDifference(BrepsA=sdiff_9, BrepsB=rotate.Geometry)
rotate_3 = Rotate(Geometry=rotate_2.Geometry, Angle=1.570796327, Plane=pl_offset)  # -> Geometry, Transform
sdiff_11 = SolidDifference(BrepsA=sdiff_10, BrepsB=rotate_2.Geometry)
sdiff_12 = SolidDifference(BrepsA=sdiff_11, BrepsB=rotate_3.Geometry)

cir_14 = Circle(Plane=pl_offset, Radius=Slider(4.5, range=0..10))
srf_16 = Surface(cir_14)
extr_18 = Extrude(Base=srf_16, Direction=button_thickness_2)
curvepoint = PointOnCurve(cir_14, parameter=0.75)
curvepoint_2 = PointOnCurve(cir_14, parameter=0.25)
move = Move(Geometry=[curvepoint_2, curvepoint], Motion=expr("-x", X))  # -> Geometry, Transform
move_2 = Move(Geometry=[curvepoint_2, curvepoint], Motion=X)  # -> Geometry, Transform
ln = Line(StartPoint=move_2.Geometry, EndPoint=move.Geometry)

rotate_4 = Rotate(Geometry=extr_14, Angle=1.570796327, Plane=pl_offset)  # -> Geometry, Transform
sdiff_13 = SolidDifference(BrepsA=sdiff_7, BrepsB=extr_14)
rotate_5 = Rotate(Geometry=rotate_4.Geometry, Angle=1.570796327, Plane=pl_offset)  # -> Geometry, Transform
sdiff_14 = SolidDifference(BrepsA=sdiff_13, BrepsB=rotate_4.Geometry)
rotate_6 = Rotate(Geometry=rotate_5.Geometry, Angle=1.570796327, Plane=pl_offset)  # -> Geometry, Transform
sdiff_15 = SolidDifference(BrepsA=sdiff_14, BrepsB=rotate_5.Geometry)
sdiff_16 = SolidDifference(BrepsA=sdiff_15, BrepsB=rotate_6.Geometry)

move_3 = Move(Geometry=ln, Motion=Y)  # -> Geometry, Transform
cir_15 = Circle(Plane=pl_offset, Radius=subtraction)
srf_17 = Surface(cir_15)
extr_19 = Extrude(Base=srf_17, Direction=central_shaft_length)
sdiff_17 = SolidDifference(BrepsA=extr_19, BrepsB=sdiff_6)
sdiff_18 = SolidDifference(BrepsA=sdiff_17, BrepsB=sdiff_12)

# ---- group: MESS TO MAKE SHEATH
cir_16 = Circle(Plane=pln, Radius=Slider(7, range=0..1000))
curvepoint_3 = PointOnCurve(cir_14, parameter=0.5)
Y_3 = UnitY(Factor=Slider(2, range=0..10, expression="-x"))
curvepoint_4 = PointOnCurve(cir_16, parameter=0.5)
curvepoint_5 = PointOnCurve(cir_16, parameter=0.5)
Y_4 = UnitY(Factor=Slider(1, range=0..10, expression="-x"))
X_2 = UnitX(Factor=Slider(0.015, range=0..10, expression="-x"))
ln_2 = Line(StartPoint=curvepoint_4, EndPoint=curvepoint_3)
move_4 = Move(Geometry=curvepoint_3, Motion=Y_4)  # -> Geometry, Transform
move_5 = Move(Geometry=curvepoint_3, Motion=Y_3)  # -> Geometry, Transform
X_3 = UnitX(Factor=Slider(0.4, range=0..10))
Y_5 = UnitY(Factor=Slider(1, range=0..10))
Y_6 = UnitY(Factor=Slider(2.026, range=0..21))
move_6 = Move(Geometry=move_4.Geometry, Motion=X_2)  # -> Geometry, Transform
curvepoint_6 = PointOnCurve(ln_2, parameter=0.5)
X_4 = UnitX(Factor=Slider(3.062, range=0..10))
move_7 = Move(Geometry=move_5.Geometry, Motion=X_3)  # -> Geometry, Transform
Y_7 = UnitY(Factor=Slider(0.1, range=0..10))
Y_8 = UnitY(Factor=Slider(2, range=0..2))
move_8 = Move(Geometry=curvepoint_6, Motion=expr("-x", Y_6))  # -> Geometry, Transform
tolerance_2 = Move(Geometry=move_6.Geometry, Motion=Y_5)  # -> Geometry, Transform
move_9 = Move(Geometry=tolerance_2.Geometry, Motion=X_4)  # -> Geometry, Transform
move_10 = Move(Geometry=move_9.Geometry, Motion=Y_8)  # -> Geometry, Transform
move_11 = Move(Geometry=move_7.Geometry, Motion=Y_7)  # -> Geometry, Transform
ln_3 = Line(StartPoint=tolerance_2.Geometry, EndPoint=move_9.Geometry)
ln_4 = Line(StartPoint=move_10.Geometry, EndPoint=curvepoint_4)
ln_5 = Line(StartPoint=move_9.Geometry, EndPoint=move_10.Geometry)
arc = Arc3Pt(PointA=curvepoint_4, PointB=move_8.Geometry, PointC=move_7.Geometry)  # -> Arc, Plane, Radius
ln_6 = Line(StartPoint=move_7.Geometry, EndPoint=move_11.Geometry)
X_5 = UnitX(Factor=Slider(0.415, range=0..1, expression="-x"))
move_12 = Move(Geometry=move_11.Geometry, Motion=X_5)  # -> Geometry, Transform
ln_7 = Line(StartPoint=move_12.Geometry, EndPoint=tolerance_2.Geometry)
ln_8 = Line(StartPoint=move_11.Geometry, EndPoint=move_12.Geometry)
pt_11 = ConstructPoint(XCoordinate=0, YCoordinate=0, ZCoordinate=0)
join = JoinCurves(Curves=[ln_7, ln_3, ln_5, ln_4, ln_8, arc.Arc, ln_6], Preserve=False)
Y_9 = UnitY(Factor=1)
rad = Radians(Degrees=Slider(180, range=0..1000))
move_13 = Move(Geometry=pt_11, Motion=Y_9)  # -> Geometry, Transform
extr_20 = Extrude(Base=move_3.Geometry, Direction=Y_2)
ln_9 = Line(StartPoint=pt_11, EndPoint=move_13.Geometry)
rotax = RotateAxis(Geometry=join, Angle=rad, Axis=ln_9)  # -> Geometry, Transform
swp1 = Sweep1(Rail=cir_16, Sections=rotax.Geometry, Miter=1)
item = ListItem(List=extr_20, Index=Slider(0, range=0..100), Wrap=True)
item_2 = ListItem(List=extr_20, Index=Slider(1, range=0..100), Wrap=True)
Z = UnitZ(Factor=Slider(0.5, range=0..100))
Z_2 = UnitZ(Factor=Slider(0.5, range=0..100))
Z_3 = UnitZ(Factor=Slider(6, range=0..100))
Z_4 = UnitZ(Factor=Slider(6, range=0..100))
move_14 = Move(Geometry=item_2, Motion=expr("-x", Z))  # -> Geometry, Transform
move_15 = Move(Geometry=item, Motion=Z_2)  # -> Geometry, Transform
extr_21 = Extrude(Base=move_14.Geometry, Direction=expr("-x", Z_4))
extr_22 = Extrude(Base=move_15.Geometry, Direction=Z_3)
sdiff_19 = SolidDifference(BrepsA=swp1, BrepsB=[extr_21, extr_22])

# ---- group: TRAFFIC LIGHT MOUNT
join_2 = BrepJoin(Breps=[sdiff_16, sdiff_3, sdiff_19])  # -> Breps, Closed

# ----
dent_radius_3 = Number(0.83)
dent_depth_3 = Vector(Vector(0, 0.22, 0))
cir_17 = Circle(Plane=pl_offset, Radius=r_i_support)
cir_18 = Circle(Plane=pl_offset, Radius=dent_radius_3)
srf_18 = Surface(cir_18)
srf_19 = Surface(cir_17)
extr_23 = Extrude(Base=srf_19, Direction=dent_depth_3)
extr_24 = Extrude(Base=srf_18, Direction=dent_depth_3)
sdiff_20 = SolidDifference(BrepsA=extr_23, BrepsB=extr_24)

angular_section_3 = Number(0.8)
number_14 = Number(1.570796327)
num_7 = Number(2)
num_8 = Number(0)
pt_12 = PointCylindrical(BasePlane=pl_offset, Angle=0, Radius=num_8, Elevation=0)
bool_3 = Boolean(True)
vec_9 = Vector(Vector(0, 2, 0))

addition = Addition(A=number_8, B=number_14)
addition_2 = Addition(A=angular_section_3, B=number_10)

pt_13 = PointCylindrical(BasePlane=pl_offset, Angle=addition_2, Radius=num_7, Elevation=0)
pt_14 = PointCylindrical(BasePlane=pl_offset, Angle=addition, Radius=num_7, Elevation=0)
pline_3 = PolyLine(Vertices=[pt_12, pt_13, pt_14], Closed=bool_3)
boundary_3 = BoundarySurfaces(Edges=pline_3)
extr_25 = Extrude(Base=boundary_3, Direction=vec_9)

rotate_7 = Rotate(Geometry=extr_25, Angle=1.570796327, Plane=pl_offset)  # -> Geometry, Transform
sdiff_21 = SolidDifference(BrepsA=sdiff_20, BrepsB=extr_25)
rotate_8 = Rotate(Geometry=rotate_7.Geometry, Angle=1.570796327, Plane=pl_offset)  # -> Geometry, Transform
sdiff_22 = SolidDifference(BrepsA=sdiff_21, BrepsB=rotate_7.Geometry)
rotate_9 = Rotate(Geometry=rotate_8.Geometry, Angle=1.570796327, Plane=pl_offset)  # -> Geometry, Transform
sdiff_23 = SolidDifference(BrepsA=sdiff_22, BrepsB=rotate_8.Geometry)
sdiff_24 = SolidDifference(BrepsA=sdiff_23, BrepsB=rotate_9.Geometry)

dent_radius_4 = Number(0.83)
dent_depth_4 = Vector(Vector(0, 1.5, 0))
cir_19 = Circle(Plane=pl_offset, Radius=r_i_support)
cir_20 = Circle(Plane=pl_offset, Radius=dent_radius_4)
srf_20 = Surface(cir_20)
srf_21 = Surface(cir_19)
extr_26 = Extrude(Base=srf_21, Direction=dent_depth_4)
extr_27 = Extrude(Base=srf_20, Direction=dent_depth_4)
sdiff_25 = SolidDifference(BrepsA=extr_26, BrepsB=extr_27)

angular_section_4 = Number(0.32)
number_15 = Number(1.570796327)
num_9 = Number(2)
num_10 = Number(0)
pt_15 = PointCylindrical(BasePlane=pl_offset, Angle=0, Radius=num_10, Elevation=0)
bool_4 = Boolean(True)
vec_10 = Vector(Vector(0, 2, 0))

addition_3 = Addition(A=number_9, B=number_15)
addition_4 = Addition(A=angular_section_4, B=number_11)

pt_16 = PointCylindrical(BasePlane=pl_offset, Angle=addition_4, Radius=num_9, Elevation=0)
pt_17 = PointCylindrical(BasePlane=pl_offset, Angle=addition_3, Radius=num_9, Elevation=0)
pline_4 = PolyLine(Vertices=[pt_15, pt_16, pt_17], Closed=bool_4)
boundary_4 = BoundarySurfaces(Edges=pline_4)
extr_28 = Extrude(Base=boundary_4, Direction=vec_10)

rotate_10 = Rotate(Geometry=extr_28, Angle=1.570796327, Plane=pl_offset)  # -> Geometry, Transform
sdiff_26 = SolidDifference(BrepsA=sdiff_25, BrepsB=extr_28)
rotate_11 = Rotate(Geometry=rotate_10.Geometry, Angle=1.570796327, Plane=pl_offset)  # -> Geometry, Transform
sdiff_27 = SolidDifference(BrepsA=sdiff_26, BrepsB=rotate_10.Geometry)
rotate_12 = Rotate(Geometry=rotate_11.Geometry, Angle=1.570796327, Plane=pl_offset)  # -> Geometry, Transform
sdiff_28 = SolidDifference(BrepsA=sdiff_27, BrepsB=rotate_11.Geometry)
sdiff_29 = SolidDifference(BrepsA=sdiff_28, BrepsB=rotate_12.Geometry)

sdiff_30 = SolidDifference(BrepsA=sdiff_18, BrepsB=sdiff_29)
sdiff_31 = SolidDifference(BrepsA=sdiff_30, BrepsB=sdiff_24)

# ---- group: BUTTON
join_3 = BrepJoin(Breps=[extr_18, sdiff_31])  # -> Breps, Closed
